# Grasshopper definition tweetLandscape.ghx (Grasshopper 0.9.76)
# plug-ins: ghJSON

tweet_count_per_hash_x = Slider(10, range=0..10)
tweet_count_per_hash_y = Slider(10, range=0..10)
file_path = Panel("D:\Dropbox\Jose Luis\Twipology\10 - DEV\twipology\tweetData\1425256368597_tweets_parsed.json")
hash_count_x = Slider(4, range=0..10)
hash_count_y = Slider(3, range=0..10)
tweet_base_height_mm = Slider(10, range=0..100)
tweet_size_x_mm = Slider(100, range=0..500)
tweet_size_y_mm = Slider(150, range=0..500)
dam = DataDam(DataA=file_path, BufferDelay=20000000, BufferMode=2)

file = ReadFile(File=dam, PerLineParse=False)
txt = Text(file)

# ----
# USING ghJSON FOR GH:
# http://mathrioshka.ru/ghjson/
panel = Panel("{\"hashArray\":")
concat = Concatenate(FragmentA=panel, FragmentB=txt, FragmentC="}")
frmjson = FromJSON(JSON=concat)

jpath = JSONPath(JObject=frmjson, JSONPathQuery="$.hashArray[*].hashtag")
hashtags = Text(simplify(graft(jpath)))

lng = ListLength(List=jpath)
series = Series(Start=0, Step=1, Count=lng)
int = Integer(series)

concat_2 = Concatenate(FragmentA="$.hashArray[", FragmentB=int, FragmentC="].tweets[*].text_length")
jpath_2 = JSONPath(JObject=frmjson, JSONPathQuery=concat_2)
tweet_length = Integer(simplify(jpath_2))

concat_3 = Concatenate(FragmentA="$.hashArray[", FragmentB=int, FragmentC="].tweets[*].word_count")
jpath_3 = JSONPath(JObject=frmjson, JSONPathQuery=concat_3)
tweet_word_count = Integer(simplify(jpath_3))

jpath_4 = JSONPath(JObject=frmjson, JSONPathQuery="$.hashArray[*].tweets[*].chars[*]")
flatten = FlattenTree(Tree=tweet_word_count, Path="{0}")
ma = MassAddition(Input=flatten)  # -> Result, PartialResults
int_2 = Integer(jpath_4)
shift = ShiftList(List=flatten(["0", ma.PartialResults]), Shift="-1", Wrap=False)  # -> flatten(List)
subtraction = Subtraction(A=ma.PartialResults, B="1")
graft = GraftTree(Tree=shift, IncludeEmptyLists=True, IncludeNullItems=True)  # -> simplify(Tree)
graft_2 = GraftTree(Tree=subtraction, IncludeEmptyLists=True, IncludeNullItems=True)  # -> simplify(Tree)
dom = ConstructDomain(DomainStart=graft, DomainEnd=graft_2)
flatten_2 = FlattenTree(Tree=dom, Path="{0}")
unflatten = UnflattenTree(Tree=flatten_2, Guide=tweet_word_count)
subset = SubList(List=int_2, Domain=unflatten, Wrap=False)  # -> List, Index
tweet_word_chars = Integer(simplify(subset.List))

concat_4 = Concatenate(FragmentA="$.hashArray[", FragmentB=int, FragmentC="].tweets[*].text")
jpath_5 = JSONPath(JObject=frmjson, JSONPathQuery=concat_4)
tweet_text = Text(simplify(jpath_5))

panel_2 = Panel(tweet_text)
panel_3 = Panel(tweet_word_chars)
c_script = CSharpScript(
    hashCountX=hash_count_x,
    hashCountY=hash_count_y,
    tweetCountHashX=tweet_count_per_hash_x,
    tweetCountHashY=tweet_count_per_hash_y,
    tweetSizeX=tweet_size_x_mm,
    tweetSizeY=tweet_size_y_mm,
    tweetBaseHeight=tweet_base_height_mm,
    hashtags=hashtags,
    tweetText=tweet_text,
    tweetLengths=tweet_length)  # -> out, meshes, A; inputs hashCountX: Int32, hashCountY: Int32, tweetCountHashX: Int32, tweetCountHashY: Int32, tweetSizeX: Double, tweetSizeY: Double, tweetBaseHeight: Double, hashtags: tree of String, tweetText: tree of String, tweetLengths: tree of Int32, tweetWords: tree of Int32, tweetChars: Int32
# ---------- c_script: C# ----------
    DataTree<Tweet> tweets = new DataTree<Tweet>();

    // iterate over hashtag blocks
    for (int V = 0; V < hashCountY; V++) {
      for (int U = 0; U < hashCountX; U++) {
        int UV = V * hashCountX + U;
        GH_Path UVpath = new GH_Path(UV);

        List<int> tweetLen = tweetLengths.Branch(UVpath);
        List<string> tweetTxt = tweetText.Branch(UVpath);
        string hash = hashtags.Branch(UVpath)[0];

        // iterate over tweets in hashtag block
        for (int v = 0; v < tweetCountHashY; v++) {
          for (int u = 0; u < tweetCountHashX; u++) {
            int uv = v * tweetCountHashX + u;

            double x = U * tweetCountHashX * tweetSizeX + u * tweetSizeX;
            double y = V * tweetCountHashY * tweetSizeY + v * tweetSizeY;
            double z = 0;
            double baseElev = tweetBaseHeight;
            string txt = tweetTxt[uv];

            Tweet T = new Tweet(UV, uv, x, y, z, tweetSizeX, tweetSizeY, baseElev, hash, txt);
            T.generateMesh();
            tweets.Add(T, UVpath);

          }
        }

      }
    }




    // Do something with the tweets

    DataTree<Point3d> tweetAnchors = new DataTree<Point3d>();
    DataTree<Mesh> tweetMeshes = new DataTree<Mesh>();

    // iterate over hashtag blocks
    for (int V = 0; V < hashCountY; V++) {
      for (int U = 0; U < hashCountX; U++) {
        int UV = V * hashCountX + U;
        GH_Path UVpath = new GH_Path(UV);
        List<Tweet> tweetList = tweets.Branch(UVpath);

        // iterate over tweets in hashtag block
        for (int v = 0; v < tweetCountHashY; v++) {
          for (int u = 0; u < tweetCountHashX; u++) {
            int uv = v * tweetCountHashX + u;

            tweetAnchors.Add(tweetList[uv].anchor, UVpath);
            tweetMeshes.Add(tweetList[uv].mesh, UVpath);


          }
        }

      }
    }


    meshes = tweetMeshes;
    A = tweetAnchors;
# ---------- c_script: C# additional code ----------
  class Tweet {
    
    public int hashId, tweetId;

    public Point3d anchor;
    public double width, height;
    public double baseElevation;

    public string hashtag;
    public string text;
      
    public Mesh mesh = new Mesh();

    public Tweet(int hashId_, int tweetId_, double x, double y, double z, double w, double h, double baseElev, string hash, string txt) {
      hashId = hashId_;
      tweetId = tweetId_;
      anchor = new Point3d(x, y, z);
      width = w;
      height = h;
      baseElevation = baseElev;
      hashtag = hash;
      text = txt;
    }

    public void generateMesh() {
      List<Point3d> verts = new List<Point3d>();
      verts.Add(new Point3d(anchor.X, anchor.Y, anchor.Z + baseElevation));
      verts.Add(new Point3d(anchor.X + width, anchor.Y, anchor.Z + baseElevation));
      verts.Add(new Point3d(anchor.X + width, anchor.Y + height, anchor.Z + baseElevation));
      verts.Add(new Point3d(anchor.X, anchor.Y + height, anchor.Z + baseElevation));
      mesh.Vertices.AddVertices(verts);

      mesh.Faces.AddFace(0, 1, 2, 3);

      mesh.Normals.ComputeNormals();
      mesh.FaceNormals.ComputeFaceNormals();
    }


  }
# ---------- end c_script ----------
panel_4 = Panel(c_script.out)
geo = Geometry(c_script.meshes)
geo_2 = Geometry(c_script.A)
flatten_3 = FlattenTree(Tree=geo, Path="{0}")
viewer = ParamViewer(c_script.A)
item = ListItem(List=flatten_3, Index=Slider(329, range=0..1000), Wrap=True)
